# Grasshopper definition wwr_sync.gh (Grasshopper 1.0.8)

_0_5_s = Trigger(Interval=500, TimerInterval=500, Target=wwr_sync)
windows_json = Panel("C:\Users\Ayden He\Documents\GitHub\ARCH 540\Passivehouse_Tool\01_Prototypes\Version_07\rhino\windows.json")
bake = BooleanToggle(False)
wwr_sync = Python3Script(path=windows_json)  # -> out, geo, ids, info
# ---------- wwr_sync: Python ----------
#! python 3
# WWR sync: read windows.json -> scale window widths -> preview -> write existing_wwr back
import json, datetime
import Rhino
import Rhino.Geometry as rg
import scriptcontext as sc

DEPTH = 0.02   # windows drawn 2 cm in front of the wall so they read over it
doc = Rhino.RhinoDoc.ActiveDoc

def facade_geo(layer_name):
    idx = doc.Layers.FindByFullPath(layer_name, -1)
    if idx < 0: return None
    objs = doc.Objects.FindByLayer(doc.Layers[idx])
    if not objs: return None
    o = objs[0]
    return o.Geometry.GetBoundingBox(True), rg.AreaMassProperties.Compute(o.Geometry).Area

def rect_brep(x, y, z, w, h):
    pl = rg.Plane(rg.Point3d(x, y, z), rg.Vector3d(1,0,0), rg.Vector3d(0,0,1))
    crv = rg.Rectangle3d(pl, w, h).ToNurbsCurve()
    br = rg.Brep.CreatePlanarBreps(crv, 0.001)
    return br[0] if br else None

with open(path, "r", encoding="utf-8") as f:
    d = json.load(f)

last = sc.sticky.get("wwr_last")
cache = sc.sticky.get("wwr_cache")
if d.get("updated_at") == last and cache:
    geo, ids, info = cache
else:
    fg = facade_geo(d["facade"]["layer"])
    if fg is None:
        raise Exception("no object on layer " + d["facade"]["layer"])
    bb, A = fg
    W = bb.Max.X - bb.Min.X; H = bb.Max.Z - bb.Min.Z
    ox, oy, oz = bb.Min.X, bb.Min.Y, bb.Min.Z
    wins = d["windows"]
    before = json.dumps([d["facade"], d.get("existing_wwr"), [(w["x"], w["width"]) for w in wins]])
    sum_base = sum(w["base_width"] * w["height"] for w in wins)
    t = d.get("target_wwr")
    k = 1.0 if t is None else t * A / sum_base
    kmax = float("inf"); kmin = 0.0
    minw = d.get("min_width", 0.0)
    for w in wins:
        b = w["base_width"]; c = w["base_x"] + b / 2.0
        kmax = min(kmax, 2 * c / b, 2 * (W - c) / b)
        kmin = max(kmin, minw / b)
    for i in range(len(wins)):
        for j in range(i + 1, len(wins)):
            wi, wj = wins[i], wins[j]
            if wi["sill"] < wj["sill"] + wj["height"] and wj["sill"] < wi["sill"] + wi["height"]:
                ci = wi["base_x"] + wi["base_width"] / 2.0; cj = wj["base_x"] + wj["base_width"] / 2.0
                kmax = min(kmax, 2 * abs(ci - cj) / (wi["base_width"] + wj["base_width"]))
    k_req = k
    k = max(kmin, min(kmax, k))
    geo = []; ids = []
    for w in wins:
        b = w["base_width"]
        w["width"] = round(k * b, 4)
        w["x"] = round(w["base_x"] + (b - w["width"]) / 2.0, 4)
        geo.append(rect_brep(ox + w["x"], oy - DEPTH, oz + w["sill"], w["width"], w["height"]))
        ids.append(w["id"])
    existing = sum(w["width"] * w["height"] for w in wins) / A
    d["facade"]["width"] = round(W, 4); d["facade"]["height"] = round(H, 4); d["facade"]["area"] = round(A, 4)
    d["existing_wwr"] = round(existing, 4)
    after = json.dumps([d["facade"], d.get("existing_wwr"), [(w["x"], w["width"]) for w in wins]])
    if after != before:
        d["updated_by"] = "gh"
        # 带毫秒：与 server.py 一致，避免两次写入落在同一秒被当成"没变"
        d["updated_at"] = datetime.datetime.now().isoformat(timespec="milliseconds")
        with open(path, "w", encoding="utf-8") as f:
            json.dump(d, f, ensure_ascii=False, indent=2)
    clamp = "" if abs(k - k_req) < 1e-9 else "  (clamped: k requested %.3f, allowed %.3f-%.3f)" % (k_req, kmin, kmax)
    info = "target_wwr: %s\nexisting_wwr: %.4f\nk: %.4f%s\nfacade: %.2f x %.2f m, %.2f m2\nwidths: %s" % (
        t, existing, k, clamp, W, H, A, ", ".join("%s=%.3f" % (w["id"], w["width"]) for w in wins))
    sc.sticky["wwr_last"] = d["updated_at"]
    sc.sticky["wwr_cache"] = (geo, ids, info)
# ---------- end wwr_sync ----------
wwr_bake = Python3Script(bake=bake, geo=wwr_sync.geo, ids=wwr_sync.ids)  # -> out, count; inputs geo: list, ids: list
# ---------- wwr_bake: Python ----------
#! python 3
# Replace-style bake: on toggle False->True, delete W## objects on layer Windows and add current windows
import re
import Rhino
import Rhino.DocObjects as rd
import rhinoscriptsyntax as rs
import scriptcontext as sc

doc = Rhino.RhinoDoc.ActiveDoc
was = sc.sticky.get("wwr_bake_was", False)
sc.sticky["wwr_bake_was"] = bool(bake)
lay = doc.Layers.FindByFullPath("Windows", -1)
if lay < 0:
    L = rd.Layer(); L.Name = "Windows"; lay = doc.Layers.Add(L)
def as_brep(g):
    b = rs.coercebrep(g, False)
    if b is None:
        s = rs.coercesurface(g, False)
        b = s.ToBrep() if s else None
    return b
if bake and not was and geo:
    for o in list(doc.Objects.FindByLayer(doc.Layers[lay])):
        if o.Name and re.fullmatch(r"W\d+", o.Name):
            doc.Objects.Delete(o, True)
    for g, name in zip(geo, ids):
        b = as_brep(g)
        if b is None: continue
        attr = rd.ObjectAttributes(); attr.LayerIndex = lay; attr.Name = str(name)
        doc.Objects.AddBrep(b, attr)
    doc.Views.Redraw()
count = len([o for o in doc.Objects.FindByLayer(doc.Layers[lay]) if o.Name and re.fullmatch(r"W\d+", o.Name)])
# ---------- end wwr_bake ----------
state = Panel(wwr_sync.info)
