# Grasshopper definition wwr_sync.gh (Grasshopper 1.0.8)

_0_5_s = Trigger(Interval=500, TimerInterval=500, Target=wwr_sync)
windows_json = Panel("C:\Users\Ayden He\Documents\GitHub\ARCH 540\Passivehouse_Tool\01_Prototypes\Version_08\rhino\windows.json")
bake = BooleanToggle(False)
wwr_sync = Python3Script(path=windows_json)  # -> out, geo, ids, info, wall
# ---------- wwr_sync: Python ----------
#! python 3
# WWR sync v2 (Version_08): the tool is the master. Wall = facade dims from the file; windows = photo pattern (fractions)
# repeated per floor; widths scaled by k from target_wwr; existing_wwr and expanded windows written back.
import json, datetime
import Rhino.Geometry as rg
import scriptcontext as sc

DEPTH = 0.02   # windows drawn 2 cm in front of the wall

def rect_brep(x, y, z, w, h):
    pl = rg.Plane(rg.Point3d(x, y, z), rg.Vector3d(1,0,0), rg.Vector3d(0,0,1))
    br = rg.Brep.CreatePlanarBreps(rg.Rectangle3d(pl, w, h).ToNurbsCurve(), 0.001)
    return br[0] if br else None

with open(path, "r", encoding="utf-8") as f:
    d = json.load(f)

last = sc.sticky.get("wwr_last"); cache = sc.sticky.get("wwr_cache2")
if d.get("updated_at") == last and cache:
    wall, geo, ids, info = cache
else:
    fa = d["facade"]; L = float(fa["width"]); H = float(fa["floor_height"]); F = int(fa["floors"])
    sill = float(fa["sill"]); head = float(fa["head"]); hw = head - sill
    pat = d["pattern"]; sumw = sum(p["w"] for p in pat)
    t = d.get("target_wwr")
    k = 1.0 if t is None else t * H / (sumw * hw)
    minw = d.get("min_width", 0.0)
    kmax = float("inf"); kmin = 0.0
    for p in pat:
        u = p["u"]; w = p["w"]; c = u + w / 2.0
        kmax = min(kmax, 2 * c / w, 2 * (1 - c) / w); kmin = max(kmin, minw / (w * L))
    for i in range(len(pat)):
        for j in range(i + 1, len(pat)):
            ci = pat[i]["u"] + pat[i]["w"] / 2.0; cj = pat[j]["u"] + pat[j]["w"] / 2.0
            kmax = min(kmax, 2 * abs(ci - cj) / (pat[i]["w"] + pat[j]["w"]))
    k_req = k; k = max(kmin, min(kmax, k))
    wall = rect_brep(0, 0, 0, L, F * H)
    geo = []; ids = []; wins = []
    for fl in range(1, F + 1):
        z = (fl - 1) * H + sill
        for p in pat:
            w = k * p["w"] * L; x = (p["u"] + (p["w"] - k * p["w"]) / 2.0) * L
            geo.append(rect_brep(x, -DEPTH, z, w, hw)); ids.append("%s-%d" % (p["id"], fl))
            wins.append({"id": "%s-%d" % (p["id"], fl), "floor": fl, "x": round(x, 4), "width": round(w, 4), "sill": round(sill, 4), "z": round(z, 4), "height": round(hw, 4)})
    existing = k * sumw * hw / H
    before = json.dumps([d.get("existing_wwr"), d.get("windows")])
    d["existing_wwr"] = round(existing, 4); d["windows"] = wins
    if json.dumps([d["existing_wwr"], d["windows"]]) != before:
        d["updated_by"] = "gh"
        d["updated_at"] = datetime.datetime.now().isoformat(timespec="milliseconds")
        with open(path, "w", encoding="utf-8") as f:
            json.dump(d, f, ensure_ascii=False, indent=2)
    clamp = "" if abs(k - k_req) < 1e-9 else "  (clamped: k requested %.3f, allowed %.3f-%.3f)" % (k_req, kmin, kmax)
    info = "target_wwr: %s\nexisting_wwr: %.4f\nk: %.4f%s\nwall: %.2f x %.2f m (%d floors x %.2f), window h %.2f\nwidths: %s" % (
        t, existing, k, clamp, L, F * H, F, H, hw, ", ".join("%s=%.3f" % (p["id"], k * p["w"] * L) for p in pat))
    sc.sticky["wwr_last"] = d["updated_at"]
    sc.sticky["wwr_cache2"] = (wall, geo, ids, info)
# ---------- end wwr_sync ----------
wwr_bake = Python3Script(bake=bake, geo=wwr_sync.geo, ids=wwr_sync.ids, wall=wwr_sync.wall)  # -> out, count; inputs geo: list, ids: list
# ---------- wwr_bake: Python ----------
#! python 3
# Replace-style bake v2: on toggle False->True, rewrite the wall (layer Facade, name "Facade") and the windows (layer Windows, names W##-#)
import re
import Rhino
import Rhino.DocObjects as rd
import rhinoscriptsyntax as rs
import scriptcontext as sc

doc = Rhino.RhinoDoc.ActiveDoc
was = sc.sticky.get("wwr_bake_was", False)
sc.sticky["wwr_bake_was"] = bool(bake)
def layer(name):
    i = doc.Layers.FindByFullPath(name, -1)
    if i < 0:
        L = rd.Layer(); L.Name = name; i = doc.Layers.Add(L)
    return i
def as_brep(g):
    b = rs.coercebrep(g, False)
    if b is None:
        s = rs.coercesurface(g, False); b = s.ToBrep() if s else None
    return b
def put(g, lay, name):
    b = as_brep(g)
    if b is None: return
    a = rd.ObjectAttributes(); a.LayerIndex = lay; a.Name = name
    doc.Objects.AddBrep(b, a)
lf, lw = layer("Facade"), layer("Windows")
if bake and not was and geo:
    for o in list(doc.Objects.FindByLayer(doc.Layers[lf])):
        if o.Name == "Facade": doc.Objects.Delete(o, True)
    for o in list(doc.Objects.FindByLayer(doc.Layers[lw])):
        if o.Name and re.fullmatch(r"W\d+-\d+", o.Name): doc.Objects.Delete(o, True)
    put(wall, lf, "Facade")
    for g, name in zip(geo, ids): put(g, lw, str(name))
    doc.Views.Redraw()
count = len([o for o in doc.Objects.FindByLayer(doc.Layers[lw]) if o.Name and re.fullmatch(r"W\d+-\d+", o.Name)])
# ---------- end wwr_bake ----------
state = Panel(wwr_sync.info)
