# Grasshopper definition Vancouver_House_Parametric.gh (Grasshopper 1.0.8)

expansion_start_z0 = Slider(42.913, range=0..80)
top_width_lx = Slider(58.18, range=20..80)
top_depth_ly = Slider(34.8, range=15..60)
expansion_end_z1 = Slider(141, range=50..200)
floor_height = Slider(3.72, range=2.5..4.5)
curve_tension = Slider(5, range=5..100)
height_h = Slider(158, range=50..250)
pt = ConstructPoint(XCoordinate=0, YCoordinate=0, ZCoordinate=0)
pt_2 = ConstructPoint(XCoordinate=top_width_lx, YCoordinate=0, ZCoordinate=0)
pt_3 = ConstructPoint(XCoordinate=0, YCoordinate=top_depth_ly, ZCoordinate=0)
pt_4 = ConstructPoint(XCoordinate=top_width_lx, YCoordinate=top_depth_ly, ZCoordinate=0)
Z = UnitZ(Factor=expansion_start_z0)
Z_2 = UnitZ(Factor=expansion_end_z1)
Z_3 = UnitZ(Factor=height_h)
Z_4 = UnitZ(Factor=curve_tension)
Z_5 = UnitZ(Factor=1)
ln = Line(StartPoint=pt, EndPoint=pt_2)
ln_2 = Line(StartPoint=pt, EndPoint=pt_3)
ln_3 = Line(StartPoint=pt_2, EndPoint=pt_3)
move = Move(Geometry=pt_4, Motion=Z_2)  # -> Geometry, Transform
move_2 = Move(Geometry=pt_4, Motion=Z_3)  # -> Geometry, Transform
midpt = CurveMiddle(Curve=ln_3)
extr = Extrude(Base=ln, Direction=Z_3)
extr_2 = Extrude(Base=ln_2, Direction=Z_3)
line = LineSDL(Start=pt_2, Direction=Z_5, Length=height_h)
line_2 = LineSDL(Start=pt_3, Direction=Z_5, Length=height_h)
move_3 = Move(Geometry=midpt, Motion=Z)  # -> Geometry, Transform
bzspan = BezierSpan(StartPoint=move_3.Geometry, StartTangent=Z_4, EndPoint=move.Geometry, EndTangent=Z_4)  # -> Curve, Length, Domain
ln_4 = Line(StartPoint=midpt, EndPoint=move_3.Geometry)
ln_5 = Line(StartPoint=move.Geometry, EndPoint=move_2.Geometry)
join = JoinCurves(Curves=[ln_4, bzspan.Curve, ln_5], Preserve=False)
flatten = FlattenTree(Tree=[line, join], Path="{0}")
flatten_2 = FlattenTree(Tree=[line_2, join], Path="{0}")
loft = Loft(Curves=flatten, Options={Adjust=False, Closed=False, LoftEnds=0, LoftSimp=0, LoftType=0, Rebuild=10, Refit=0.01})
loft_2 = Loft(Curves=flatten_2, Options={Adjust=False, Closed=False, LoftEnds=0, LoftSimp=0, LoftType=0, Rebuild=10, Refit=0.01})
flatten_3 = FlattenTree(Tree=[extr, extr_2, loft, loft_2], Path="{0}")
join_2 = BrepJoin(Breps=flatten_3)  # -> Breps, Closed
cap = CapHoles(Brep=join_2.Breps)
contour = Contour(Shape=cap, Point=pt, Direction=Z_5, Distance=floor_height)
